# Grasshopper definition sunpath_examle.gh (Grasshopper 1.0.7)
# plug-ins: GHSolar

mesh = Mesh([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])
panel = Panel([Slider(47.8, range=-90..90), Slider(24.331, range=-90..90)])
pt = Point(Point(1.217606507, -23.38239725, 0))
skydome = GHSkydome(
    RecursionLevel=Slider(2, range=0..3),
    Viewfactors=Toggle(False),
    CumSkyMatrix=Toggle(False),
    SunPath=Toggle(True),
    HOY=Slider(2481, range=0..8759),
    Location=panel,
    Size=Slider(1, range=0..2),
    Context=mesh,
    Sp=pt)  # -> Mesh, Vectors, Sunpaths, SunGeo
